# Grasshopper definition test1.gh (Grasshopper 1.0.8)
# plug-ins: Selva

uibridge = UIBridge(Enable=Toggle(True))
get_number = GetNumber(Slider(8, range=0..100), AtLeast=1, AtMost=1, Maximum=1.797693135e+308, Minimum=-1.797693135e+308, TreeAccess=False)
pt = PointOriented(BasePlane=PlaneXY(0, 0, 0), UComponent=0, VComponent=0, WComponent=0)
c_bake = ContextBake(Content=uibridge)
sph = Sphere(Base=pt, Radius=get_number)
c_bake_2 = ContextBake(Content=sph)
